# Grasshopper definition IfcHopperShell.ghx (Grasshopper 1.0.8)

# ----
# 1 - File
ifcmodel = Python3Script()  # -> Mo; inputs Sv: String, N: String, D: String, An: String, As: String, O: String, Au: String
#   port Sv: The version of IFC. Can be "IFC2X3", "IFC4" or "IFC4X3". (Default is "IFC4")
#   port N: The name of the model. (Default is "Hopper Model")
#   port D: The description of the model. (Default is "...")
#   port An: The author name of the model. (Default is "...")
#   port As: The author surname of the model. (Default is "...")
#   port O: The organization authring of the model. (Default is "...")
#   port Au: The manager responsible for the model. (Default is "...")
#   port Mo: The IfcOpenShell model.
# ---------- ifcmodel: Python ----------
import ifchoppershell

Mo = ifchoppershell.file.ifc_model_component(Sv, N, D, An, As, O, Au)
# ---------- end ifcmodel ----------
ifcread = Python3Script()  # -> Mo, Sv; inputs FP: String
#   port FP: The full file path ending in ".ifc".
#   port Mo: The IfcOpenShell model.
#   port Sv: The version of IFC.
# ---------- ifcread: Python ----------
import ifchoppershell

Mo, Sv = ifchoppershell.file.ifc_read_component(FP)
# ---------- end ifcread ----------
ifcwrite = Python3Script()  # -> FP; inputs D: String, Fn: String, W: Boolean
#   port Mi: The IfcOpenShell model.
#   port D: The folder where to save the file. (Default is an "IfcHopperShell" folder in the user root)
#   port Fn: The file name. (Default is "Hopper File")
#   port W: A boolean to trigger file write. Use a button. (Default is False)
#   port FP: The full path where the file is saved to.
# ---------- ifcwrite: Python ----------
import ifchoppershell

FP = ifchoppershell.file.ifc_write_component(Mi, D, Fn, W)
# ---------- end ifcwrite ----------
ifcgetmesh = Python3Script()  # -> M, C, StepId, PsetIds, QtoIds; inputs In: list of String, Ex: list of String
#   port Mi: The IfcOpenShell model.
#   port In: A list of ifc classes to include in the query (other will be excluded).
#   port Ex: A list of ifc classes to exclude from the query (others will be included).
#   port M: The meshes found in the model.
#   port C: The colors assigned to the meshes.
#   port StepId: The step id of the related objects.
#   port PsetIds: The id of the connected psets
#   port QtoIds: The ids of the connected qtos.
# ---------- ifcgetmesh: Python ----------
import ifchoppershell

M, C, StepId, PsetIds, QtoIds = ifchoppershell.file.ifc_get_mesh_component(Mi, In, Ex)
# ---------- end ifcgetmesh ----------

# ----
# 2 - Space
ifcproject = Python3Script()  # -> Mo, PId; inputs N: String
#   port Mi: The IfcOpenShell model.
#   port N: The project name. (Default is Hopper Project)
#   port Mo: The IfcOpenShell model.
#   port PId: The IFC project Id.
# ---------- ifcproject: Python ----------
import ifchoppershell

Mo, PId = ifchoppershell.space.ifc_project_component(ghenv.Component, Mi, N)
# ---------- end ifcproject ----------
ifcsite = Python3Script(Mi="IfcProject")  # -> Mo, SId; inputs ROId: Int32, N: list of String
#   port Mi: The IfcOpenShell model.
#   port ROId: The relating object ID, usually a project ID.
#   port N: A list of site names. (Default is "Hopper Site")
#   port Mo: The IfcOpenShell model.
#   port SId: The IFC site Id.
# ---------- ifcsite: Python ----------
import ifchoppershell

Mo, SId = ifchoppershell.space.ifc_site_component(Mi, ROId, N)
# ---------- end ifcsite ----------
ifccontext = Python3Script()  # -> Mo, CId; inputs Ct: String, Ci: String, Tv: String, PCId: Int32
#   port Mi: The IfcOpenShell model.
#   port Ct: "Model" if you are working in 3d or "Plan" if you are working in 2d. (Default is "Model")
#   port Ci: The “Identifier” describes the purpose of the representation. Can be: - "Body": for the actual shape of the object - "Box": the bounding box of the object - "Axis": the parametric line determining the shape of the object - "Profile": the elevation slihouette of the object - "Footprint": the plan view silhouette of the object - "Clearance": the clearance zone of the object. - "Annotation": symbolic annotations typically used in diagrams or drawings (Default is "Body")
#   port Tv: The "Target View” describes the typical diagrammatic presentation that context’s geometry should be viewed in. Can be: - "MODEL_VIEW": for 3D geometry you might see in a BIM viewer - "PLAN_VIEW": for 2D geometry you might see in a plan representation - "ELEVATION_VIEW": for 2D geometry you might see in an elevation representation - "SECTION_VIEW": for 2D geometry you might see in a section representation - "GRAPH_VIEW": for 2D or 3D line or frame or path connectivity diagrams you might use for structural frame analysis, axis-based parametric modeling - "SKETCH_VIEW": for viewing abstract high-level representations such as in bubble diagrams of spatial topology (Default is "MODEL_VIEW")
#   port PCId: If this is a subcontext, a parent context id should be provided.
#   port Mo: The IfcOpenShell model.
#   port CId: The IFC context Id.
# ---------- ifccontext: Python ----------
import ifchoppershell

Mo, CId = ifchoppershell.space.ifc_context_component(Mi, Ct, Ci, Tv, PCId)
# ---------- end ifccontext ----------
ifcgeoreference = Python3Script()  # -> Mo, CId; inputs CRS: Int32, Es: Double, Ns: Double, Na: Double, Os: Double
#   port Mi: The IfcOpenShell model.
#   port CRS: The EPSG code for the projection. (Default is 4326)
#   port Es: The longitude of the project. (Default is 0.0)
#   port Ns: The latitude of the project origin. (Default is 0.0)
#   port Na: The angle between the project and world north, counterclockwise is positive. (Default is 0.0)
#   port Os: The scale at the origin. (Dafault is 1.0)
#   port Mo: The IfcOpenShell model.
#   port CId: Georeferencing is assigned to a context, this is the Id of that context.
# ---------- ifcgeoreference: Python ----------
import ifchoppershell

Mo, CId = ifchoppershell.space.ifc_georeference_component(Mi, CRS, Es, Ns, Na, Os)
# ---------- end ifcgeoreference ----------
ifcbuilding = Python3Script()  # -> Mo, BId; inputs ROId: Int32, N: list of String
#   port Mi: The IfcOpenShell model.
#   port ROId: The relating object id, usually an Ifc Site.
#   port N: A list of building names. (Default is "Hopper Building")
#   port Mo: The IfcOpenShell model.
#   port BId: The IFC building Id.
# ---------- ifcbuilding: Python ----------
import ifchoppershell

Mo, BId = ifchoppershell.space.ifc_building_component(Mi, ROId, N)
# ---------- end ifcbuilding ----------
ifcfacility = Python3Script()  # -> Mo, FId; inputs ROId: Int32, N: list of String, T: list of Int32
#   port Mi: The IfcOpenShell model.
#   port ROId: The relating object id, usually an Ifc Site.
#   port N: A list of facility names. (Default is "Hopper Facility")
#   port T: The facility type (0 = IfcFacility, 1 = IfcRoad, 2 = IfcBridge, 3 = IfcRailway, 4 = IfcMarineFacility)
#   port Mo: The IfcOpenShell model.
#   port FId: The IFC facility Id.
# ---------- ifcfacility: Python ----------
import ifchoppershell

Mo, FId = ifchoppershell.space.ifc_facility_component(Mi, ROId, N, T)
# ---------- end ifcfacility ----------
ifcbuildingstorey = Python3Script()  # -> Mo, StId; inputs N: list
#   port Mi: The IfcOpenShell model.
#   port ROId: The relating object id, usually an Ifc Building.
#   port N: A list of storey names. (Default is "Hopper Storey")
#   port Mo: The IfcOpenShell model.
#   port StId: The IFC storey Id.
# ---------- ifcbuildingstorey: Python ----------
import ifchoppershell

Mo, StId = ifchoppershell.space.ifc_building_storey_component(Mi, ROId, N)
# ---------- end ifcbuildingstorey ----------
ifcfacilitypart = Python3Script(Mi="IfcProject")  # -> Mo, FPId; inputs ROId: Int32, N: list of String, T: Int32
#   port Mi: The IfcOpenShell model.
#   port ROId: The relating object ID, usually a project ID.
#   port N: A list of site names. (Default is "Hopper Site")
#   port T: The type of facility part.
#   port Mo: The IfcOpenShell model.
#   port FPId: The IFC facility part Id.
# ---------- ifcfacilitypart: Python ----------
import ifchoppershell

Mo, FPId = ifchoppershell.space.ifc_facility_part_component(ghenv.Component, Mi, ROId, N, T)
# ---------- end ifcfacilitypart ----------
ifcspace = Python3Script(Mi="IfcProject")  # -> Mo, SId; inputs ROId: Int32, N: list of String
#   port Mi: The IfcOpenShell model.
#   port ROId: The relating object ID, usually a project ID.
#   port N: A list of site names. (Default is "Hopper Site")
#   port Mo: The IfcOpenShell model.
#   port SId: The IFC site Id.
# ---------- ifcspace: Python ----------
import ifchoppershell

Mo, SId = ifchoppershell.space.ifc_space_component(Mi, ROId, N)
# ---------- end ifcspace ----------

# ----
# 3 - Object
ifcobject = Python3Script()  # -> Mo, ObId; inputs N: tree of String, ROId: tree of Int32, CId: tree of Int32, Cs: tree of String, Ak: tree, Av: tree, M: tree of Mesh, SyId: tree of Int32
#   port Mi: The IfcOpenShell model.
#   port N: A tree of names. (Default is "Hopper Object")
#   port ROId: A list of relating object ids, usually the storey, the building, the road etc.
#   port CId: A list of context ids.
#   port Cs: A list of Ifc Classes. (Default is "IfcBuildingElementProxy")
#   port Ak: A list of keyes for the attributes.
#   port Av: A tree of values for the attributes.
#   port M: A list of meshes that make up the representation of this object. Note: a mesh is not required, an object can exist without a geometric reperesentation.
#   port SyId: The style id to use.
#   port Mo: The IfcOpenShell model.
#   port ObId: The IFC object Id.
# ---------- ifcobject: Python ----------
import ifchoppershell

Mo, ObId = ifchoppershell.object.ifc_object_component(Mi, N, ROId, CId, Cs, Ak, Av, M, SyId, ghenv.Component)
# ---------- end ifcobject ----------
ifcpset = Python3Script()  # -> Mo, PsetId; inputs ObId: list of Int32, K: list of String, V: tree of String
#   port Mi: The IfcOpenShell model.
#   port N: The name of the Pset. (Default is "Hopper Pset")
#   port ObId: A list of object ids to assign the Pset to.
#   port K: A list of keys.
#   port V: A tree of values, one branch per object.
#   port Mo: The IfcOpenShell model.
#   port PsetId: The IFC Pset Id.
# ---------- ifcpset: Python ----------
import ifchoppershell

Mo, PsetId = ifchoppershell.object.ifc_pset_component(Mi, N, ObId, K, V)
# ---------- end ifcpset ----------
ifcqto = Python3Script()  # -> Mo, QtoId; inputs ObId: list, Qt: list of String, K: list, V: tree
#   port Mi: The IfcOpenShell model.
#   port N: The name of the Qto. (Default is "Hopper Qto")
#   port ObId: A list of object ids to assign the Pset to.
#   port Qt: A type. Can be: - "Number" - "Count" - "Length" - "Area" - "Volume" - "Time" (Default is "Length")
#   port K: A list of keys.
#   port V: A tree of values, one branch per object.
#   port Mo: The IfcOpenShell model.
#   port QtoId: The IFC Qto Id.
# ---------- ifcqto: Python ----------
import ifchoppershell

Mo, QtoId = ifchoppershell.object.ifc_qto_component(Mi, N, ObId, Qt, K, V)
# ---------- end ifcqto ----------
ifcstyle = Python3Script()  # -> Mo, SyId; inputs C: list of Color, N: list of String
#   port Mi: The IfcOpenShell model.
#   port C: A list of colors.
#   port N: A list of names for the styles. (Default is "Hopper Style")
#   port Mo: The IfcOpenShell model.
#   port SyId: The IFC style id.
# ---------- ifcstyle: Python ----------
import ifchoppershell

Mo, SyId = ifchoppershell.object.ifc_style_component(Mi, C, N)
# ---------- end ifcstyle ----------

# ----
# 4 - Utilities
ifcgetinfobyid = Python3Script()  # -> K, V; inputs StepId: list of Int32
#   port Mi: The IfcOpenShell model.
#   port StepId: The Id of the object to get the info from.
# ---------- ifcgetinfobyid: Python ----------
import ifchoppershell

K, V = ifchoppershell.utilities.ifc_get_info_by_id_component(Mi, StepId)
# ---------- end ifcgetinfobyid ----------
ifcgetinfobyguid = Python3Script()  # -> K, V; inputs Guid: list of String
#   port Mi: The IfcOpenShell model.
#   port Guid: The Guid of the object to get the info from.
# ---------- ifcgetinfobyguid: Python ----------
import ifchoppershell

K, V = ifchoppershell.utilities.ifc_get_info_by_guid_component(Mi, Guid)
# ---------- end ifcgetinfobyguid ----------
ifcgetidbytype = Python3Script()  # -> StepId; inputs Ty: list of String
#   port Mi: The IfcOpenShell model.
#   port Ty: The Ifc type.
# ---------- ifcgetidbytype: Python ----------
import ifchoppershell

StepId = ifchoppershell.utilities.ifc_get_id_by_type_component(Mi, Ty)
# ---------- end ifcgetidbytype ----------
