# Grasshopper definition 02 Read and explore.gh (Grasshopper 1.0.8)
# plug-ins: IfcHopper

# 02 Read and explore
# Reads the IFC file written by sample 01 and walks the spatial structure with the Deconstruct components: only what you deconstruct is loaded.
# Element outputs preview the objects in their IFC colours; right-click an Element output and Bake to bake them, named after the object.
panel = Panel("ifc/01 First building.ifc")

# ---- group: 1. The header, without reading the model
read_ifc_header = ReadIFCHeader(Path=panel)  # -> Project, Schema, Description, ImplementationLevel, Name, TimeStamp, Author, Organization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
panel_2 = Panel(read_ifc_header.Schema)
panel_3 = Panel(read_ifc_header.OriginatingSystem)

# ---- group: 2. Read IFC, then deconstruct project > site > facility > storey > object
read_ifc = ReadIFC(Path=panel)
deconstruct_model = DeconstructModel(Model=read_ifc)  # -> Project, Author, Organization, Source
deconstruct_project = DeconstructProject(Project=deconstruct_model.Project)  # -> Name, Description, GlobalId, Sites, Facilities, Contexts, Units, Georeference, PropertySets, Classifications
deconstruct_site = DeconstructSite(Site=deconstruct_project.Sites)  # -> Name, Description, GlobalId, Sites, Facilities, Spaces, Elements, PropertySets, Classifications, Placement
deconstruct_facility = DeconstructFacility(Facility=deconstruct_site.Facilities)  # -> Name, Description, GlobalId, Class, Type, Storeys, Parts, Spaces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
deconstruct_storey = DeconstructStorey(Storey=deconstruct_facility.Storeys)  # -> Name, Description, GlobalId, Elevation, Spaces, Elements, PropertySets, Classifications, Placement
deconstruct_object = DeconstructObject(Object=deconstruct_storey.Elements)  # -> Name, Description, GlobalId, Class, Type, Geometry, Colour, Parts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

# ---- group: 3. Object values (one per object)
panel_4 = Panel(deconstruct_object.Name)
panel_5 = Panel(deconstruct_object.Class)
panel_6 = Panel(deconstruct_object.GlobalId)
