# Grasshopper definition 05 Spaces.gh (Grasshopper 1.0.8)
# plug-ins: IfcHopper

# ---- group: 1. Contents and properties of the living room
# 05 Spaces
# Spaces (IfcSpace) belong to a storey, a facility part or the site; they can nest (partial spaces) and contain objects, e.g. furniture.
# Pset_SpaceCommon gives a space its standard properties, typed from the IFC 4.3 templates. Spaces have a placement but no body geometry yet.
center_box = CenterBox(Base=PlaneXY(3.5, 3, 0.375), X=0.8, Y=0.45, Z=0.375)
object = Object(Class="IfcFurniture", Name="Table", Type="TABLE", Geometry=center_box, AdvancedInputsExpanded=True)
pset = Pset(Name="Pset_SpaceCommon", Names=["Reference", "IsExternal", "PubliclyAccessible"], Values=["R01", False, False])

# ---- group: 2. Spaces: the reading corner is part of the living room
space = Space(Name="Reading corner", Type="SPACE", Placement=PlaneXY(0.2, 0.2, 0), AdvancedInputsExpanded=True)
space_2 = Space(Name="Garden", Type="EXTERNAL", Placement=PlaneXY(-1, -9, 0), AdvancedInputsExpanded=True)
space_3 = Space(
    Name="Living room",
    Type="INTERNAL",
    Spaces=space,
    Elements=object,
    PropertySets=pset,
    Placement=PlaneXY(0.1, 0.1, 0),
    AdvancedInputsExpanded=True)

# ---- group: 3. The living room is in the storey, the garden on the site
storey = Storey(Name="Hopper Storey", Elevation=0, Spaces=space_3, AdvancedInputsExpanded=True)
building = Building(Name="Hopper Building", Storeys=storey, AdvancedInputsExpanded=True)
site = Site(Name="Hopper Site", Facilities=building, Spaces=space_2, AdvancedInputsExpanded=True)
project = Project(Name="Spaces", Sites=site, AdvancedInputsExpanded=True)

# ---- group: Write: set Write to true; the file goes to the ifc folder next to this definition
model = Model(Project=project)
write = BooleanToggle(False)
write_ifc = WriteIFC(Model=model, Name="05 Spaces", Directory="ifc", Write=write)
panel = Panel(write_ifc)
