# Grasshopper definition 11 Openings.gh (Grasshopper 1.0.8)
# plug-ins: IfcHopper

# ---- group: 1. Opening volumes (larger than the wall thickness, except the niche)
# 11 Openings
# Openings (IfcOpeningElement) void the object they are connected to: the wall keeps its uncut body in the file and is shown cut.
# Doors and windows fill an opening (Fills) and must also be in the storey. A recess cuts only part of the thickness.
# Construction volumes and opening previews are hidden so they do not cover the cuts; enable their Preview to inspect them.
center_box = CenterBox(Base=PlaneXY(1.5, 0.1, 1.05), X=0.5, Y=0.2, Z=1.05)
center_box_2 = CenterBox(Base=PlaneXY(4.5, 0.1, 1.5), X=0.75, Y=0.2, Z=0.6)
center_box_3 = CenterBox(Base=PlaneXY(3, 0.17, 1.2), X=0.3, Y=0.05, Z=0.3)

# ---- group: 2. The door and the window
object = Object(Class="IfcDoor", Name="Door", Type="DOOR", Geometry=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, AdvancedInputsExpanded=True)
object_2 = Object(Class="IfcWindow", Name="Window", Type="WINDOW", Geometry=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, AdvancedInputsExpanded=True)

# ---- group: 3. Openings, filled by the door and the window; the niche is a recess
opening = Opening(Name="Door opening", Type="OPENING", Geometry=center_box, Fills=object, AdvancedInputsExpanded=True)
opening_2 = Opening(Name="Window opening", Type="OPENING", Geometry=center_box_2, Fills=object_2, AdvancedInputsExpanded=True)
opening_3 = Opening(Name="Niche", Type="RECESS", Geometry=center_box_3, AdvancedInputsExpanded=True)

# ---- group: 4. The wall with its openings: Geometry is cut, Openings and Fills deconstruct
object_3 = Object(
    Class="IfcWall",
    Name="Wall",
    Type="SOLIDWALL",
    Geometry=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,
    Openings=[opening, opening_2, opening_3],
    AdvancedInputsExpanded=True)
deconstruct_object = DeconstructObject(Object=<missing>)  # -> Name, Description, GlobalId, Class, Type, Geometry, Colour, Parts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
panel = Panel(deconstruct_object.Name)
panel_2 = Panel(deconstruct_object.Fills)

# ---- group: Spatial structure: storey > building > site > project
storey = Storey(Name="Ground floor", Elevation=0, Elements=[object_3, object, object_2], AdvancedInputsExpanded=True)
building = Building(Name="Hopper Building", Storeys=storey, AdvancedInputsExpanded=True)
site = Site(Name="Hopper Site", Facilities=building, AdvancedInputsExpanded=True)
project = Project(Name="Openings", Sites=site, AdvancedInputsExpanded=True)

# ---- group: Write: set Write to true; the file goes to the ifc folder next to this definition
model = Model(Project=project)
write = BooleanToggle(False)
write_ifc = WriteIFC(Model=model, Name="11 Openings", Directory="ifc", Write=write)
panel_3 = Panel(write_ifc)
